# Dynamo graph SPLINE_BY_POINTS.dyn (Dynamo 0.6.2.29585)

number = DoubleInput(0)
number_2 = DoubleInput(1)
number_slider = DoubleSliderInput(5.742605915, range=1..8)
number_3 = DoubleInput(20)
number_sequence = NumberSeq(number_2, number_slider, number_3, lacing=Longest)
number_4 = DoubleInput(30)
multiply = Multiplication(number_4, lacing=Longest)
random_number_list = RandomList(number_slider)
map = Map(multiply, random_number_list)
XYZ = Xyz(number, number_sequence, map, lacing=Longest)
reference_point = ReferencePointByXyz(XYZ, lacing=Longest)
number_5 = DoubleInput(1)
curve_by_points = CurveByPoints(reference_point, number_5, lacing=Longest)
